# Grasshopper definition slicer.gh (Grasshopper 1.0.7)

outer = Slider(20, range=20..40)
points = Slider(24, range=10..30)
inner = Slider(6, range=1..10)
python = GhPythonScript(inner_radius=inner, outer_radius=outer, num_points=points)  # -> curve, points
# ---------- python: Python ----------
import math
import random
import rhinoscriptsyntax as rs

points = []
for p in range(int(num_points)):
    theta = p * (2 * math.pi / num_points)
    length = inner_radius + (random.random() * (outer_radius - inner_radius))
    x = length*math.cos(theta)
    y = length*math.sin(theta)
    points.append(rs.AddPoint([x, y, 0]))

points.append(points[0])
# ---------- end python ----------
trigger = Trigger(Interval=-1000, TimerInterval=1000, Target=python_2)
vec = VectorXYZ(XComponent=0, YComponent=0, ZComponent=Slider(5, range=1..10))  # -> Vector, Length
intcrv = Interpolate(Vertices=python.points, Degree=3, Periodic=False, KnotStyle=1)  # -> Curve, Length, Domain
crv = Curve(<curve referenced from the Rhino model>)
extr = Extrude(Base=crv, Direction=vec.Vector)
python_2 = GhPythonScript()  # -> out, file
# ---------- python_2: Python ----------
import rhinoscriptsyntax as rs

filter = "GCode (*.gcode)|*.gcode|All Files (*.*)|*.*||"
file = rs.SaveFileName("", filter)
# ---------- end python_2 ----------
cap = CapHoles(Brep=extr)
geo = Geometry(<brep referenced from the Rhino model>)
dam = DataDam(DataA=python_2.file, BufferDelay=10000000, BufferMode=0)
dam_2 = DataDam(DataA=geo, BufferDelay=10000000, BufferMode=0)
python_3 = GhPythonScript(filename=dam, shape=dam_2)  # -> out, lines, turtle, print_bed, travel, vert_tree, height_planes; inputs shape: Brep
# ---------- python_3: Python ----------
# code required so that library reloads appropriately
# must be above other import statements
import sys
import math
import time
import operator as op
to_delete = list()
for module in sys.modules:
    if "tree_utils" in module:
      to_delete.append(module)
    if "geometry_utils" in module:
      to_delete.append(module)
    if "vertical_utils" in module:
      to_delete.append(module)
    if "slicing_utils" in module:
      to_delete.append(module)
    if "extruder_turtle" in module:
      to_delete.append(module)
    if "turtle_utilities" in module:
      to_delete.append(module)
for module in to_delete:
    sys.modules.pop(module)

import slicing_utils
from slicing_utils import *

import vertical_utils
from vertical_utils import *

import extruder_turtle
from extruder_turtle import *

import turtle_utilities as tu

import Rhino
import rhinoscriptsyntax as rs

reload(slicing_utils)
reload(extruder_turtle)


# Main code
# set up the turtle
t = ExtruderTurtle()
t.setup(filename=filename, printer = "eazao")

print("standard layer height is: " +str(t.get_layer_height()))
print("standard extrusion width is: "+str(t.get_extrude_width()))

# draw
#travel = slice_fermat_fill(t, shape, wall_mode=True, walls=2, fill_bottom=True, bottom_layers=2)
#travel = slice_fermat_fill(t, shape)
#travel = slice_spiral_fill(t, shape)
#travel = slice_contour_fill(t, shape)

#layer = 1
#travel = fill_layer_with_fermat_spiral(t, shape, layer*t.get_layer_height())
travel = []
vert_tree = build_vertical_tree(t, shape)
all_nodes = vert_tree.get_all_nodes([])
print(len(all_nodes))

nozzle_width = 8
nozzle_height = 30
height = int(math.floor(get_shape_height(shape) / nozzle_height))
print("total height: "+str(height))

h = 0
nodes_at_height = [node for node in all_nodes if node.height == h]
print("number of super_nodes at height "+str(h)+": "+str(len(nodes_at_height)))

for node in nodes_at_height:
    descendants = node.get_all_descendants()
    print(node.data)
    print([n.data for n in descendants])
    #print([n.data for n in node.get_all_ancestors()])

#travel = subdivide_by_overlap(nodes_at_height, nozzle_width)

#for n in nodes_at_height:
    #travel = travel + [node.data for node in n.sub_nodes]

#for n in all_nodes:
    #travel = travel + [node.data for node in n.sub_nodes]
    #print(n.data, n.depth, n.height, len(n.sub_nodes))

#plane = get_plane(layer*t.get_layer_height())
#curves = rs.AddSrfContourCrvs(shape, plane)
#travel, pnts, disc = get_isocontour(t, curves[0])

# visualize the turtle's path
#turtle = t.draw_turtle()
lines = t.get_lines()
print_bed = t.draw_print_bed()

# close the generated .gcode file
t.finish()
# ---------- end python_3 ----------
crv_2 = Curve(python_3.lines)
srf = Surface(python_3.print_bed)
crv_3 = Curve(python_3.travel)
pln = Plane(python_3.height_planes)

join = JoinCurves(Curves=python_3.lines, Preserve=False)
divide = DivideCurve(Curve=join, Count=Slider(500, range=0..1000), Kinks=False)  # -> flatten(Points), Tangents, Parameters
dom = ConstructDomain(DomainStart=0, DomainEnd=Slider(0, range=0..15000))
panel = Panel(divide.Points)
subset = SubList(List=divide.Points, Domain=dom, Wrap=True)  # -> List, Index
intcrv_2 = Interpolate(Vertices=subset.List, Degree=3, Periodic=False, KnotStyle=1)  # -> Curve, Length, Domain
